# Grasshopper definition ELK1电池组（平面数据信息）.gh (Grasshopper 1.0.7)
# plug-ins: Human

我是osm文件路径 = FilePath("C:\Users\QQEQWR\Desktop\map.osm")
loc = Location(Stream=我是osm文件路径)  # -> OSMPointData, OSMData, LongitudeDomain, LatitudeDomain
panel = Panel("amenity")
panel_2 = Panel("barrier")
panel_3 = Panel("bicycle")
panel_4 = Panel("Cuisine")
panel_5 = Panel("access")
panel_6 = Panel("atm")
panel_7 = Panel(".........刚写到C其他的按教程自己搜去哈~")
# 这堆是楼
# 大路
majorroads = MajorRoads(OSMPointData=loc.OSMPointData, XMLData=loc.OSMData, CollectionType=0)  # -> Primary, PrimaryLinks, Secondary, SecondaryLinks, Tertiary, RoadKey
# 小路
minorroads = MinorRoads(OSMPointData=loc.OSMPointData, XMLData=loc.OSMData, CollectionType=0)  # -> Residential, Unclassified, NotClassified, RoadKey
# 轨道交通
railways = RailWays(OSMPointData=loc.OSMPointData, XMLData=loc.OSMData, CollectionType=0)  # -> Rail, Tram, LightRail, Subway, MonoRail, NarrowGauge, RailKey
# 高速路
hwy = Highways(OSMPointData=loc.OSMPointData, XMLData=loc.OSMData, CollectionType=0)  # -> Motorways, MotorwayLinks, Trunks, TrunkLinks, RoadKey
genosm = GenericOSM(OSMPointData=loc.OSMPointData, OSMDataString=loc.OSMData, FeatureKey="building", FeatureValue="*", CollectionType=0)  # -> FeaturePoints, FeatureKey
water = WaterWays(OSMPointData=loc.OSMPointData, XMLData=loc.OSMData, CollectionType=0)  # -> Coastlines, Lakes, Rivers, Riverbanks, Streams, Canals, ManMade, Dams, WaterKey
panel_8 = Panel(minorroads.RoadKey)
panel_9 = Panel(hwy.RoadKey)
pline = PolyLine(Vertices=genosm.FeaturePoints, Closed=False)
pline_2 = PolyLine(Vertices=minorroads.Residential, Closed=False)
pline_3 = PolyLine(Vertices=minorroads.Unclassified, Closed=False)
pline_4 = PolyLine(Vertices=majorroads.PrimaryLinks, Closed=False)
pline_5 = PolyLine(Vertices=minorroads.NotClassified, Closed=False)
pline_6 = PolyLine(Vertices=hwy.Trunks, Closed=False)
pline_7 = PolyLine(Vertices=hwy.TrunkLinks, Closed=False)
pline_8 = PolyLine(Vertices=majorroads.Primary, Closed=False)
pline_9 = PolyLine(Vertices=majorroads.Tertiary, Closed=False)
pline_10 = PolyLine(Vertices=hwy.Motorways, Closed=False)
pline_11 = PolyLine(Vertices=hwy.MotorwayLinks, Closed=False)
pline_12 = PolyLine(Vertices=majorroads.Secondary, Closed=False)
pline_13 = PolyLine(Vertices=majorroads.SecondaryLinks, Closed=False)
panel_10 = Panel(water.WaterKey)
panel_11 = Panel(railways.RailKey)
pline_14 = PolyLine(Vertices=railways.LightRail, Closed=False)
pline_15 = PolyLine(Vertices=railways.Subway, Closed=False)
pline_16 = PolyLine(Vertices=railways.Rail, Closed=False)
pline_17 = PolyLine(Vertices=railways.Tram, Closed=False)

# ----
# 水系
pline_18 = PolyLine(Vertices=water.ManMade, Closed=False)
pline_19 = PolyLine(Vertices=water.Dams, Closed=False)
pline_20 = PolyLine(Vertices=water.Streams, Closed=False)
pline_21 = PolyLine(Vertices=water.Canals, Closed=False)
pline_22 = PolyLine(Vertices=water.Rivers, Closed=False)
pline_23 = PolyLine(Vertices=water.Riverbanks, Closed=False)
pline_24 = PolyLine(Vertices=water.Coastlines, Closed=False)
pline_25 = PolyLine(Vertices=water.Lakes, Closed=False)

number_slider = Slider(3000, range=0..10000)
我是线宽 = Number(5)
我是线宽_2 = Number(5)
我是线宽_3 = Number(5)
我是线宽_4 = Number(5)
我是线宽_5 = Number(5)
boundary = BoundarySurfaces(Edges=pline)
pipeline = GeometryPipeline(
    GroupByLayer=False,
    GroupByType=False,
    IncludeHidden=True,
    IncludeLocked=True,
    LayerFilter="*",
    NameFilter="*",
    SublayerFiltering=True,
    TypeFilter=0)
createatts = CreateAttributes(Color=ColourSwatch(SwatchColor=RGB(255, 255, 255)), enableFullPath=False)
previewlw = CustomPreviewLineweights(Geometry=[pline_2, pline_5, pline_3], Shader=ColourSwatch(SwatchColor=RGB(214, 214, 214)), Thickness=我是线宽)
preview = CustomPreview(Geometry=boundary, Shader=ColourSwatch(SwatchColor=RGB(0, 0, 0)))
previewlw_2 = CustomPreviewLineweights(Geometry=[pline_10, pline_11, pline_6, pline_7], Shader=ColourSwatch(SwatchColor=RGB(214, 214, 214)), Thickness=我是线宽_3)
previewlw_3 = CustomPreviewLineweights(
    Geometry=[pline_8, pline_12, pline_9, pline_4, pline_13],
    Shader=ColourSwatch(SwatchColor=RGB(214, 214, 214)),
    Thickness=我是线宽_2)
previewlw_4 = CustomPreviewLineweights(Geometry=[pline_16, pline_17, pline_14, pline_15], Shader=ColourSwatch(SwatchColor=RGB(214, 214, 214)), Thickness=我是线宽_4)
previewlw_5 = CustomPreviewLineweights(
    Geometry=[pline_24, pline_25, pline_22, pline_23, pline_20, pline_21, pline_18, pline_19],
    Shader=ColourSwatch(SwatchColor=RGB(214, 214, 214)),
    Thickness=我是线宽_5)
bake = BakeGeometry(Bake=Toggle(False), Geometry=pline, Attributes=createatts)
loft = Loft(Curves=pline_4, Options={Adjust=False, Closed=False, LoftEnds=0, LoftSimp=0, LoftType=0, Rebuild=10, Refit=0.01})
number_slider_2 = Slider(1057.8, range=0..8000)
pt = ConstructPoint(XCoordinate=number_slider_2, YCoordinate=expr("-x", 0), ZCoordinate=0)
pt_2 = ConstructPoint(XCoordinate=expr("-x", number_slider_2), YCoordinate=0, ZCoordinate=0)
ln = Line(StartPoint=pt_2, EndPoint=pt)
crv = Curve()
crv_2 = Curve(ln)
pcen = PolygonCenter(Polyline=crv_2)  # -> CenterV, CenterE, CenterA
divide = DivideCurve(Curve=crv, Count=Slider(80, range=0..100), Kinks=False)  # -> Points, Tangents, Parameters
pt_3 = Point(pcen.CenterE)
eval = EvaluateCurve(Curve=crv, Parameter=divide.Parameters)  # -> Point, Tangent, Angle
Y = UnitY(Factor=1)
vec2pt = Vector2Pt(PointA=pt_3, PointB=eval.Point, Unitize=False)  # -> Vector, Length
angle = Angle(VectorA=eval.Tangent, VectorB=Y)  # -> Angle, Reflex
move = Move(Geometry=crv_2, Motion=vec2pt.Vector)  # -> Geometry, Transform
rotate = Rotate(Geometry=move.Geometry, Angle=angle.Angle, Plane=eval.Point)  # -> Geometry, Transform
loft_2 = Loft(Curves=rotate.Geometry, Options={Adjust=False, Closed=False, LoftEnds=0, LoftSimp=0, LoftType=0, Rebuild=10, Refit=0.01})
cap = CapHoles(Brep=loft_2)
