# Grasshopper definition ELK2电池组（建筑带高度）.gh (Grasshopper 1.0.7)
# plug-ins: HDTReference, ElkGHComponents

path = FilePath("C:\Users\Administrator\Desktop\天河.osm")
loc = Location(FilePathText=path)  # -> OSMPointData, OSMFile, LongitudeDomain, LatitudeDomain
osm = OSMData(OSMPointData=loc.OSMPointData, OSMFilePath=loc.OSMFile, Feature="highway", Generate3d=True, IndividualOutputs=False)  # -> Ways, Buildings, FeatureKey
pline = PolyLine(Vertices=osm.Ways, Closed=False)
boundary = BoundarySurfaces(Edges=pline)  # -> simplify(Surfaces)

# ----
# 提取层数值
panel = Panel("building:levels:")
panel_2 = Panel(osm.Buildings)
rep = ReplaceText(Text=panel_2, Find=panel, RecursiveReplace=False)  # -> simplify(Result)
panel_3 = Panel(rep)
int = Integer(rep)
null = NullItem(Item=int)  # -> NullFlags, InvalidFlags, Description
dispatch = Dispatch(List=rep, DispatchPattern=null.InvalidFlags)  # -> ListA, ListB

createatts = CreateAttributes(Color=ColourSwatch(SwatchColor=RGB(18, 255, 89)), enableFullPath=False)

# ---- group: 将有层数信息的高度与随机高度合并
multiplication = Multiplication(A=dispatch.ListB, B="4000")
# 随机建筑高度范围
clean = CleanTree(RemoveNulls=True, RemoveInvalid=True, RemoveEmpty=True, Tree=multiplication)

# ---- group: 将空值替换为随机层数数值
# 随机建筑高度范围
viewer = ParamViewer(multiplication)
null_2 = NullItem(Item=multiplication)  # -> NullFlags, InvalidFlags, Description
graft = GraftTree(Tree=viewer, IncludeEmptyLists=True, IncludeNullItems=True)
dispatch_2 = Dispatch(List=graft, DispatchPattern=null_2.InvalidFlags)  # -> ListA, ListB
clean_2 = CleanTree(RemoveNulls=True, RemoveInvalid=True, RemoveEmpty=True, Tree=dispatch_2.ListA)  # -> simplify(Tree)
flatten = FlattenTree(Tree=clean_2, Path="{0}")
lng = ListLength(List=flatten)
random = Random(Range=Domain(4, 20), Number=lng, Seed=2)  # -> graft(Random)
int_2 = Integer(random)
multiplication_2 = Multiplication(A=int_2, B="1000")
viewer_2 = ParamViewer(multiplication_2)
replace = ReplacePaths(Data=multiplication_2, Search=viewer_2, Replace=flatten(clean_2))

# ---- group: 将有层数信息的高度与随机高度合并 (continued)
merge = Merge(Data1=clean, Data2=replace)
Z = UnitZ(Factor=merge)
extr = Extrude(Base=boundary, Direction=Z)

# ----
bake = BakeGeometry(Bake=extr, Attributes=createatts)
